# Grasshopper definition hypar new.gh (Grasshopper 1.0.8)

number_slider = Slider(12, range=0..100)
number_slider_2 = Slider(12, range=0..100)
number_slider_3 = Slider(12, range=0..100)
length = Slider(20, range=0..100)
neg = Negative(Value=number_slider_2)
origin_pt = ConstructPoint(XCoordinate=0, YCoordinate=0, ZCoordinate=0)
wing_pt_1 = ConstructPoint(XCoordinate=number_slider, YCoordinate=number_slider_2, ZCoordinate=number_slider_3)
wing_pt_2 = ConstructPoint(XCoordinate=number_slider, YCoordinate=neg, ZCoordinate=number_slider_3)
opp_pt = ConstructPoint(XCoordinate=length, YCoordinate=0, ZCoordinate=0)
ln = Line(StartPoint=wing_pt_2, EndPoint=opp_pt)
ln_2 = Line(StartPoint=origin_pt, EndPoint=wing_pt_1)
divide = DivideCurve(Curve=ln, Count=10, Kinks=False)  # -> Points, Tangents, Parameters
divide_2 = DivideCurve(Curve=ln_2, Count=10, Kinks=False)  # -> Points, Tangents, Parameters
panel_number_each_axis = Slider(7, range=0..10)
ln_3 = Line(StartPoint=divide_2.Points, EndPoint=divide.Points)
loft = Loft(Curves=ln_3, Options={Adjust=False, Closed=False, LoftEnds=0, LoftSimp=0, LoftType=0, Rebuild=10, Refit=0.01})
divide_3 = DivideDomain²(Domain=loft, UCount=panel_number_each_axis, VCount=panel_number_each_axis)
subsrf = Isotrim(Surface=loft, Domain=divide_3)
area = Area(Geometry=subsrf)  # -> Area, Centroid
circle = CircleCNR(Center=area.Centroid, Normal=Vector(0, 0, 1), Radius=0.5)
panel_number_each_axis_2 = Slider(10, range=0..10)
project = Project(Curve=circle, Brep=subsrf, Direction=Vector(0, 0, 1))
srfsplit = SurfaceSplit(Surface=flatten(subsrf), Curves=flatten(project))
neg_2 = Negative(Value=Slider(0.378, range=0..1))
cull = CullPattern(List=srfsplit, CullPattern=[True, False])
cull_2 = CullPattern(List=srfsplit, CullPattern=[False, True])
sbox = SurfaceBox(Surface=subsrf, Domain=divide_3, Height=neg_2)
planar = IsPlanar(Surface=cull, Interior=True)  # -> Planar, Plane
amp = Amplitude(Vector=planar.Plane, Amplitude=1)
extr = Extrude()
vec2pt = Vector2Pt(Unitize=False)  # -> Vector, Length
