# Grasshopper definition hypar panel.gh (Grasshopper 1.0.8)

dimensions_of_panel = Slider(8.696, range=0..100)
xy = XYPlane(Origin=Point(0, 0, 0))
box = CenterBox(Base=xy, X=dimensions_of_panel, Y=dimensions_of_panel, Z=1)
number_slider = Slider(1, range=0..1)
radius_of_hole = Slider(4.575, range=0..5)
debrep = DeconstructBrep(Brep=box)  # -> Faces, Edges, Vertices
item = ListItem(List=debrep.Faces, Index=[0, 1, 2, 3], Wrap=True)
cyl = Cylinder(Base=[box, xy], Radius=radius_of_hole, Length=3)
divide = DivideDomain²(Domain=item, UCount=1, VCount=3)
move = Move(Geometry=cyl, Motion=Vector(0, 0, -1.978576626))  # -> Geometry, Transform
path_mapper = PathMapper(divide, source="{A;B;C}", target="{B;C}")
cap = CapHoles(Brep=move.Geometry)
trim = TrimTree(Tree=divide, Depth=1)
box_w_hole = SolidDifference(BrepsA=box, BrepsB=cap)
subsrf = Isotrim(Surface=graft(item), Domain=path_mapper)
item_2 = ListItem(List=subsrf, Index=1, Wrap=True)
rev = Reverse(Vector=item_2)
amp = Amplitude(Vector=rev, Amplitude=Slider(1, range=0..1))
extr = Extrude(Base=item_2, Direction=amp)
rev_2 = Reverse(Vector=amp)
extr_2 = Extrude(Base=item_2, Direction=rev_2)
panel_female = SolidDifference(BrepsA=box_w_hole, BrepsB=flatten(extr))
sunion = SolidUnion(Breps=[box_w_hole, extr_2])
X = UnitX(Factor=Slider(48.677, range=0..100))
X_2 = UnitX(Factor=Slider(23.972, range=0..100))
move_2 = Move(Geometry=panel_female, Motion=X)  # -> Geometry, Transform
move_3 = Move(Geometry=sunion, Motion=X_2)  # -> Geometry, Transform
