# Grasshopper definition hyparnew(1).gh (Grasshopper 1.0.8)

X = Slider(2000, range=0..10000)
Y = Slider(3000, range=0..10000)
Z = Slider(3000, range=0..10000)
length = Slider(4000, range=0..10000)
neg = Negative(Value=Y)
origin_pt = ConstructPoint(XCoordinate=0, YCoordinate=0, ZCoordinate=0)
wing_pt_1 = ConstructPoint(XCoordinate=X, YCoordinate=Y, ZCoordinate=Z)
wing_pt_2 = ConstructPoint(XCoordinate=X, YCoordinate=neg, ZCoordinate=Z)
opp_pt = ConstructPoint(XCoordinate=length, YCoordinate=0, ZCoordinate=0)
ln = Line(StartPoint=wing_pt_2, EndPoint=opp_pt)
ln_2 = Line(StartPoint=origin_pt, EndPoint=wing_pt_1)
Z_2 = Slider(0, range=-5000..5000)
Y_2 = Slider(27, range=-5000..5000)
X_2 = Slider(-30, range=-5000..5000)
divide = DivideCurve(Curve=ln_2, Count=10, Kinks=False)  # -> Points, Tangents, Parameters
divide_2 = DivideCurve(Curve=ln, Count=10, Kinks=False)  # -> Points, Tangents, Parameters
panel_number_each_axis = Slider(6, range=0..10)
ln_3 = Line(StartPoint=divide.Points, EndPoint=divide_2.Points)
attractor_pt = ConstructPoint(XCoordinate=X_2, YCoordinate=Y_2, ZCoordinate=Z_2)
loft = Loft(Curves=ln_3, Options={Adjust=False, Closed=False, LoftEnds=0, LoftSimp=0, LoftType=0, Rebuild=10, Refit=0.01})
sph = Sphere(Base=attractor_pt, Radius=1)
divide_3 = DivideDomain²(Domain=loft, UCount=panel_number_each_axis, VCount=panel_number_each_axis)
i = Index(0)
subsrf = Isotrim(Surface=loft, Domain=divide_3)
lng = ListLength(List=subsrf)  # -> expr("x-1", Length)
divisor_scale = Slider(40, range=0..150)
cull_i = CullIndex(List=subsrf, Indices=flatten([i, lng]), Wrap=True)
item = ListItem(List=subsrf, Index=[i, lng], Wrap=True)
area = Area(Geometry=cull_i)  # -> Area, Centroid
dist = Distance(PointA=attractor_pt, PointB=area.Centroid)
division = Division(A=dist, B=divisor_scale)
circle_radii = CircleCNR(Center=area.Centroid, Normal=Vector(0, 0, 1), Radius=division)  # -> graft(Circle)
item_2 = ListItem(List=flatten(item), Index=0, Wrap=True)
project = Project(Curve=circle_radii, Brep=subsrf, Direction=Vector(0, 0, 1))
panel_thickness = Slider(100, range=0..1000)
debrep = DeconstructBrep(Brep=item)  # -> Faces, Edges, Vertices
srfsplit = SurfaceSplit(Surface=flatten(cull_i), Curves=flatten(project))
movetoplane = MoveToPlane(Geometry=debrep.Vertices, Plane=PlaneXY(0, 0, 0), Above=True, Below=True)  # -> Geometry, Transform
item_3 = ListItem(List=debrep.Vertices, Index=0, Wrap=True)  # -> Item, Item1, Item2, Item3
surface_circles = CullPattern(List=srfsplit, CullPattern=[False, True])
item_4 = ListItem(List=movetoplane.Geometry, Index=0, Wrap=True)  # -> Item, Item1, Item2, Item3
neg_2 = Negative(Value=panel_thickness)
surface_holed = CullPattern(List=srfsplit, CullPattern=[True, False])
area_2 = Area(Geometry=item)  # -> Area, Centroid
tbox = TwistedBox(
    CornerA=item_3.Item,
    CornerB=item_3.Item1,
    CornerC=item_3.Item2,
    CornerD=item_3.Item3,
    CornerE=item_4.Item,
    CornerF=item_4.Item1,
    CornerG=item_4.Item2,
    CornerH=item_4.Item3)
offset = OffsetSurface(Surface=item, Distance=neg_2, Retrim=True)
offset_2 = OffsetSurface(Surface=surface_holed, Distance=neg_2, Retrim=True)
area_3 = Area(Geometry=offset)  # -> Area, Centroid
area_4 = Area(Geometry=surface_holed)  # -> Area, Centroid
area_5 = Area(Geometry=offset_2)  # -> Area, Centroid
ln_4 = Line(StartPoint=area_2.Centroid, EndPoint=area_3.Centroid)
ln_5 = Line(StartPoint=area_4.Centroid, EndPoint=area_5.Centroid)
seq = Sequence(Notation="[N-1] + [N-2]", Length=20, Initial=[1, 1])
dimensions_of_panel = Slider(8.696, range=0..100)
extr = Extrude(Base=item, Direction=ln_4)
seq_2 = Sequence(Notation="[N-1] + [N-2]", Length=20, Initial=[1, 1])
extr_2 = Extrude(Base=surface_holed, Direction=ln_5)
seq_3 = Sequence(Notation="[N-1] + [N-2]", Length=20, Initial=[1, 1])
volume = Volume(Geometry=extr_2)  # -> Volume, Centroid
xy = XYPlane(Origin=Point(0, 0, 0))
scale = Scale(Geometry=extr_2, Center=volume.Centroid, Factor=0.9)  # -> flatten(Geometry), Transform
seq_4 = Sequence(Notation="[N-1] + [N-2]", Length=20, Initial=[1, 1])
series = Series(Start=1, Step=2, Count=36)
item_5 = ListItem(List=flatten(scale.Geometry), Index=0, Wrap=True)
box = CenterBox(Base=xy, X=dimensions_of_panel, Y=dimensions_of_panel, Z=1)
item_6 = ListItem(List=scale.Geometry, Index=series, Wrap=True)
cull_i_2 = CullIndex(List=scale.Geometry, Indices=series, Wrap=True)
path_mapper = PathMapper(scale.Geometry, source="{A}(i)", target="{A;i}")
radius_of_hole = Slider(4.575, range=0..5)
debrep_2 = DeconstructBrep(Brep=box)  # -> Faces, Edges, Vertices
cull = CullPattern(List=cull_i_2, CullPattern=[True, False])
viewer = ParamViewer(scale.Geometry)
debrep_3 = DeconstructBrep(Brep=item_5)  # -> Faces, Edges, Vertices
item_7 = ListItem(List=debrep_2.Faces, Index=[0, 1, 2, 3], Wrap=True)
cyl = Cylinder(Base=[box, xy], Radius=radius_of_hole, Length=3)
divide_4 = DivideDomain²(Domain=item_7, UCount=1, VCount=3)
item_8 = ListItem(List=debrep_3.Faces, Index=[1, 2, 3, 4], Wrap=True)
panel = Panel(path_mapper)
divide_5 = DivideDomain²(Domain=item_8, UCount=3, VCount=1)
move = Move(Geometry=cyl, Motion=Vector(0, 0, -1.978576626))  # -> Geometry, Transform
path_mapper_2 = PathMapper(divide_4, source="{A;B;C}", target="{B;C}")
path_mapper_3 = PathMapper(divide_5, source="{A;B;C}", target="{B;C}")
cap = CapHoles(Brep=move.Geometry)
box_w_hole = SolidDifference(BrepsA=box, BrepsB=cap)
subsrf_2 = Isotrim(Surface=graft(item_7), Domain=path_mapper_2)
subsrf_3 = Isotrim(Surface=graft(item_8), Domain=path_mapper_3)
item_9 = ListItem(List=subsrf_2, Index=1, Wrap=True)
item_10 = ListItem(List=subsrf_3, Index=1, Wrap=True)
rev = Reverse(Vector=item_9)
amp = Amplitude(Vector=rev, Amplitude=Slider(1, range=0..1))
amp_2 = Amplitude(Vector=item_10, Amplitude=Slider(41.8, range=0..100))
extr_3 = Extrude(Base=item_9, Direction=amp)
rev_2 = Reverse(Vector=amp)
extr_4 = Extrude(Base=item_10, Direction=amp_2)
extr_5 = Extrude(Base=item_9, Direction=rev_2)
panel_female = SolidDifference(BrepsA=box_w_hole, BrepsB=flatten(extr_3))
sunion = SolidUnion(Breps=box_w_hole)
X_3 = UnitX(Factor=Slider(48.677, range=0..100))
X_4 = UnitX(Factor=Slider(23.972, range=0..100))
move_2 = Move(Geometry=panel_female, Motion=X_3)  # -> Geometry, Transform
move_3 = Move(Geometry=sunion, Motion=X_4)  # -> Geometry, Transform
