# Grasshopper definition hyparnew.gh (Grasshopper 1.0.8)

Y = Slider(3000, range=0..10000)
Z = Slider(3000, range=0..10000)
X = Slider(2000, range=0..10000)
hypar_length = Slider(4000, range=0..10000)
neg = Negative(Value=Y)
opp_pt = ConstructPoint(XCoordinate=hypar_length, YCoordinate=0, ZCoordinate=0)
wing_pt_1 = ConstructPoint(XCoordinate=X, YCoordinate=Y, ZCoordinate=Z)
wing_pt_2 = ConstructPoint(XCoordinate=X, YCoordinate=neg, ZCoordinate=Z)
origin_pt = ConstructPoint(XCoordinate=0, YCoordinate=0, ZCoordinate=0)
ln = Line(StartPoint=origin_pt, EndPoint=opp_pt)
ln_2 = Line(StartPoint=origin_pt, EndPoint=wing_pt_1)
ln_3 = Line(StartPoint=wing_pt_2, EndPoint=opp_pt)
attractor_pt_y = Slider(0, range=-5000..5000)
attractor_pt_z = Slider(4000, range=-5000..5000)
attractor_pt_x = Slider(0, range=-10000..10000)
midpt = CurveMiddle(Curve=ln)
divide = DivideCurve(Curve=ln_2, Count=10, Kinks=False)  # -> Points, Tangents, Parameters
divide_2 = DivideCurve(Curve=ln_3, Count=10, Kinks=False)  # -> Points, Tangents, Parameters
panel_number_each_axis_odd_number_only = Slider(5, range=0..10)
vec = VectorXYZ(XComponent=attractor_pt_x, YComponent=attractor_pt_y, ZComponent=attractor_pt_z)  # -> Vector, Length
ln_4 = Line(StartPoint=divide.Points, EndPoint=divide_2.Points)
loft = Loft(Curves=ln_4, Options={Adjust=False, Closed=False, LoftEnds=0, LoftSimp=0, LoftType=0, Rebuild=10, Refit=0.01})
attractor_pt = Move(Geometry=midpt, Motion=vec.Vector)  # -> Geometry, Transform
divide_3 = DivideDomain²(Domain=loft, UCount=panel_number_each_axis_odd_number_only, VCount=panel_number_each_axis_odd_number_only)
subsrf = Isotrim(Surface=loft, Domain=divide_3)
i = Index(0)
lng = ListLength(List=subsrf)  # -> expr("x-1", Length)
item = ListItem(List=subsrf, Index=[i, lng], Wrap=True)
cull_i = CullIndex(List=subsrf, Indices=flatten([i, lng]), Wrap=True)
debrep = DeconstructBrep(Brep=item)  # -> Faces, Edges, Vertices
area = Area(Geometry=cull_i)  # -> Area, Centroid
movetoplane = MoveToPlane(Geometry=debrep.Vertices, Plane=PlaneXY(0, 0, 0), Above=True, Below=True)  # -> Geometry, Transform
multiplier_scale = Slider(500, range=0..10000)
dist = Distance(PointA=attractor_pt.Geometry, PointB=area.Centroid)
item_2 = ListItem(List=debrep.Vertices, Index=0, Wrap=True)  # -> Item, Item1, Item2, Item3
item_3 = ListItem(List=movetoplane.Geometry, Index=0, Wrap=True)  # -> Item, Item1, Item2, Item3
division = Division(A=1000, B=dist)
pedestal_stand = TwistedBox(
    CornerA=item_2.Item,
    CornerB=item_2.Item1,
    CornerC=item_2.Item2,
    CornerD=item_2.Item3,
    CornerE=item_3.Item,
    CornerF=item_3.Item1,
    CornerG=item_3.Item2,
    CornerH=item_3.Item3)
multiplication = Multiplication(A=division, B=multiplier_scale)
circle_radii = CircleCNR(Center=area.Centroid, Normal=Vector(0, 0, 1), Radius=multiplication)  # -> graft(Circle)
project = Project(Curve=circle_radii, Brep=subsrf, Direction=Vector(0, 0, 1))
area_2 = Area(Geometry=item)  # -> Area, Centroid
srfsplit = SurfaceSplit(Surface=flatten(cull_i), Curves=flatten(project))
panel_thickness = Slider(100, range=0..1000)
surface_circles = CullPattern(List=srfsplit, CullPattern=[False, True])
surface_holed = CullPattern(List=srfsplit, CullPattern=[True, False])
neg_2 = Negative(Value=panel_thickness)
offset = OffsetSurface(Surface=item, Distance=neg_2, Retrim=True)
offset_2 = OffsetSurface(Surface=surface_holed, Distance=neg_2, Retrim=True)
area_3 = Area(Geometry=surface_holed)  # -> Area, Centroid
area_4 = Area(Geometry=offset)  # -> Area, Centroid
area_5 = Area(Geometry=offset_2)  # -> Area, Centroid
ln_5 = Line(StartPoint=area_2.Centroid, EndPoint=area_4.Centroid)
ln_6 = Line(StartPoint=area_3.Centroid, EndPoint=area_5.Centroid)
extr = Extrude(Base=item, Direction=ln_5)
extr_2 = Extrude(Base=surface_holed, Direction=ln_6)
volume = Volume(Geometry=extr_2)  # -> Volume, Centroid
scale = Scale(Geometry=extr_2, Center=volume.Centroid, Factor=0.9)  # -> flatten(Geometry), Transform
cull = CullPattern(List=scale.Geometry, CullPattern=[True, False])
cull_2 = CullPattern(List=scale.Geometry, CullPattern=[False, True])
debrep_2 = DeconstructBrep(Brep=cull)  # -> Faces, Edges, Vertices
graft = GraftTree(Tree=cull_2, IncludeEmptyLists=True, IncludeNullItems=True)
item_4 = ListItem(List=debrep_2.Faces, Index=[1, 2, 3, 4], Wrap=True)
divide_4 = DivideDomain²(Domain=item_4, UCount=3, VCount=1)
path_mapper = PathMapper(divide_4, source="{A;B;C}", target="{B;C}")
subsrf_2 = Isotrim(Surface=graft(item_4), Domain=path_mapper)
item_5 = ListItem(List=subsrf_2, Index=1, Wrap=True)
amp = Amplitude(Vector=item_5, Amplitude=Slider(140, range=0..200))
connectors = Extrude(Base=item_5, Direction=amp)
volume_2 = Volume(Geometry=connectors)  # -> Volume, Centroid
connectors_2 = Scale(Geometry=connectors, Center=volume_2.Centroid, Factor=0.9)  # -> Geometry, Transform
sdiff = SolidDifference(BrepsA=graft, BrepsB=flatten(connectors_2.Geometry))
